# Grasshopper definition M02_Measure_end_to_end.ghx (Grasshopper 1.0.8)

path = FilePath("/Users/brianho/Developer/GitHub/intro-to-urban-data/Measure/example_data/saved_data.csv")
file = ReadFile(File=path, PerLineParse=True)
split = SplitList(List=file, Index="1")  # -> ListA, ListB
split_2 = TextSplit(Text=split.ListA, Separators=",")  # -> simplify(Result)
split_3 = TextSplit(Text=split.ListB, Separators=",")  # -> simplify(Result)
item = ListItem(List=split_3, Index="1", Wrap=True)  # -> simplify(flatten(Item))
item_2 = ListItem(List=split_3, Index="2", Wrap=True)  # -> simplify(flatten(Item))
item_3 = ListItem(List=split_3, Index="3", Wrap=True)  # -> simplify(flatten(Item))
panel = Panel(split_2)
pt = ConstructPoint(XCoordinate=item_2, YCoordinate=item, ZCoordinate=item_3)
multiplication = Multiplication(A=item_3, B=Slider(44, range=0..100))
sph = Sphere(Base=pt, Radius=multiplication)
preview = CustomPreview(Geometry=sph, Material=ColourSwatch(SwatchColor=RGB(255, 254, 255)))
