# Grasshopper definition M05_Rhino_and_Grasshopper.ghx (Grasshopper 1.0.8)
# plug-ins: PTComponentLibrary

# Right click this node to “Set one Geometry”
geo = Geometry(<curve referenced from the Rhino model>)
bbox = BoundingBox(Content=geo, Plane=PlaneXY(0, 0, 0))  # -> Box, Box_2
debox = DeconstructBox(Box=bbox.Box)  # -> Plane, X, Y, Z
number_slider = Slider(15, range=0..30)
number_slider_2 = Slider(20, range=0..30)
dedomain = DeconstructDomain(Domain=debox.X)  # -> Start, End
dedomain_2 = DeconstructDomain(Domain=debox.Y)  # -> Start, End
dedomain_3 = DeconstructDomain(Domain=debox.Z)  # -> Start, End
subtraction = Subtraction(A=dedomain_2.End, B=dedomain_2.Start)
subtraction_2 = Subtraction(A=dedomain.End, B=dedomain.Start)
pt = ConstructPoint(XCoordinate=dedomain.Start, YCoordinate=dedomain_2.Start, ZCoordinate=dedomain_3.Start)
division = Division(A=subtraction, B=number_slider)
division_2 = Division(A=subtraction_2, B=number_slider_2)
# Right click this node to “Set one Geometry”
ptplanar = PlanarGrid(
    BasePoint=pt,
    IDir=Vector(1, 0, 0),
    JDir=Vector(0, 1, 0),
    IDistance=division,
    JDistance=division_2,
    INumber=number_slider,
    JNumber=number_slider_2)
pttrim = TrimGrid(Grid=ptplanar, BRep=geo, Mode=Slider(1, range=0..2))  # -> simplify(flatten(Grid))
pipeline = GeometryPipeline(
    GroupByLayer=False,
    GroupByType=False,
    IncludeHidden=True,
    IncludeLocked=True,
    LayerFilter="Buildings::Surface_Facade",
    SublayerFiltering=True,
    TypeFilter=1073741848)
pt_2 = Point(<point referenced from the Rhino model>)
clean = CleanTree(RemoveNulls=True, RemoveInvalid=True, RemoveEmpty=False, Tree=pttrim)
ln = Line(StartPoint=clean, EndPoint=pt_2)
ivray = IsoVistRay(Sample=ln, Radius=Slider(1000, range=0..1000), Obstacles=pipeline)  # -> Point, Distance, Index
bnd = Bounds(Numbers=ivray.Distance)
dom = ConstructDomain(DomainStart="1", DomainEnd=Slider(8, range=0..10))
remap = RemapNumbers(Value=ivray.Distance, Source=bnd, Target=dom)  # -> Mapped, Clipped
cir = Circle(Plane=clean, Radius=remap.Mapped)
remap_2 = RemapNumbers(Value=ivray.Distance, Source=bnd, Target=Domain(0, 1))  # -> Mapped, Clipped
gradient = Gradient(
    LowerLimit=0,
    UpperLimit=1,
    Parameter=remap_2.Mapped,
    stops=[0: RGB(234, 38, 0), 0.25: RGB(234, 126, 0), 0.5: RGB(254, 244, 84), 0.75: RGB(173, 203, 249), 1: RGB(75, 107, 169)])
boundary = BoundarySurfaces(Edges=cir)
Z = UnitZ(Factor=remap.Mapped)
extr = Extrude(Base=boundary, Direction=Z)
preview = CustomPreview(Geometry=extr, Material=gradient)
