# Grasshopper definition S02_Welcome_to_Grasshopper.ghx (Grasshopper 1.0.7)

path = FilePath("/Users/brianho/Developer/GitHub/intro-to-urban-data/Scale/example.csv")
panel = Panel(path)
file = ReadFile(File=path, PerLineParse=True)
split = TextSplit(Text=file, Separators=";")  # -> simplify(Result)
flip = FlipMatrix(Data=split)
split_2 = SplitList(List=flip, Index="1")  # -> flatten(ListA), simplify(ListB)
panel_2 = Panel(split_2.ListA)
panel_3 = Panel("""4
5
6
7""")
panel_4 = Panel("""1
2
3""")
branch = TreeBranch(Tree=split_2.ListB, Path=panel_3, MaintainPaths=True)
branch_2 = TreeBranch(Tree=split_2.ListB, Path=panel_4, MaintainPaths=True)

rep = ReplaceText(Text=branch, Find="[", RecursiveReplace=False)
rep_2 = ReplaceText(Text=rep, Find="]", RecursiveReplace=False)
rep_3 = ReplaceText(Text=rep_2, Find=" ", RecursiveReplace=False)
bang = ExplodeTree(Data=rep_3)  # -> Branch0, Branch1, Branch2, Branch3
split_3 = TextSplit(Text=bang.Branch0, Separators=",")  # -> simplify(Result)
split_4 = TextSplit(Text=bang.Branch1, Separators=",")  # -> simplify(Result)
split_5 = TextSplit(Text=bang.Branch2, Separators=",")  # -> simplify(Result)
split_6 = TextSplit(Text=bang.Branch3, Separators=",")  # -> simplify(Result)

split_7 = SplitList(List=branch_2, Index="1")  # -> simplify(flatten(ListA)), simplify(ListB)
bang_2 = ExplodeTree(Data=split_7.ListB)  # -> Branch0, Branch1, Branch2
rad = Radians(Degrees=bang_2.Branch0)
pt = ConstructPoint(XCoordinate=bang_2.Branch2, YCoordinate=bang_2.Branch1, ZCoordinate=0)

multiplication = Multiplication(A=split_3, B=Slider(0.4, range=0..1))
ma = MassAddition(Input=multiplication)  # -> Result, PartialResults
Y = UnitY(Factor=ma.PartialResults)
pt_2 = Point(pt)
move = Move(Geometry=simplify(graft(pt_2)), Motion=Y)  # -> Geometry, Transform
split_8 = SplitList(List=move.Geometry, Index="9")  # -> simplify(ListA), ListB
ins = InsertItems(List=split_8.ListA, Item=simplify(graft(pt_2)), Indices="0", Wrap=True)  # -> simplify(List)

rgb = ColourRGB(Alpha=255, Red=split_4, Green=split_5, Blue=split_6)

rectangle = Rectangle(Plane=ins, XSize=Slider(488, range=0..1000), YSize=multiplication, Radius=0)  # -> Rectangle, Length
rotate = Rotate(Geometry=rectangle.Rectangle, Angle=simplify(graft(rad)), Plane=simplify(graft(pt)))  # -> Geometry, Transform
mesh = Mesh(rotate.Geometry)
preview = CustomPreview(Geometry=mesh, Material=rgb)
